# Grasshopper definition Pyramids_cells.gh (Grasshopper 1.0.8)

xz_plane = XZPlane(Origin=Point(0, 0, 0))
number_of_cells_y = GetInteger(Slider(5, range=0..10), AtLeast=1, AtMost=1, Maximum=2147483647, Minimum=-2147483648, TreeAccess=False)
number_of_cells_x = GetInteger(Slider(6, range=0..10), AtLeast=1, AtMost=1, Maximum=2147483647, Minimum=-2147483648, TreeAccess=False)
size_of_opening = GetInteger(Slider(23, range=0..100), AtLeast=1, AtMost=1, Maximum=2147483647, Minimum=-2147483648, TreeAccess=False)
size_of_triangle = GetInteger(Slider(13, range=0..100), AtLeast=1, AtMost=1, Maximum=2147483647, Minimum=-2147483648, TreeAccess=False)
triangular = Triangular(Plane=xz_plane, Size=size_of_triangle, ExtentX=number_of_cells_x, ExtentY=number_of_cells_y)  # -> graft(Cells), Points
explode = Explode(Curve=triangular.Cells, Recursive=True)  # -> Segments, Vertices
list_item = ListItem(List=explode.Segments, Index=0, Wrap=True)  # -> Item, Item1, Item2
unit_y = UnitY(Factor=1)
area = Area(Geometry=triangular.Cells)  # -> Area, Centroid
negative = Negative(Value=unit_y)
line_sdl = LineSDL(Start=area.Centroid, Direction=negative, Length=Slider(2, range=0..10))
point_on_curve = PointOnCurve([list_item.Item2, list_item.Item1, list_item.Item], parameter=0)
point_on_curve_2 = PointOnCurve([list_item.Item2, list_item.Item1, list_item.Item], parameter=1)
end_points = EndPoints(Curve=line_sdl)  # -> Start, End
list_item_2 = ListItem(List=point_on_curve_2, Index=0, Wrap=True)  # -> Item, Item1, Item2
list_item_3 = ListItem(List=point_on_curve, Index=0, Wrap=True)  # -> Item, Item1, Item2
line = Line(StartPoint=list_item_2.Item2, EndPoint=list_item_3.Item2)
line_2 = Line(StartPoint=list_item_2.Item2, EndPoint=end_points.End)
line_3 = Line(StartPoint=list_item_3.Item2, EndPoint=end_points.End)
line_4 = Line(StartPoint=end_points.End, EndPoint=list_item_3.Item1)
line_5 = Line(StartPoint=list_item_2.Item1, EndPoint=end_points.End)
line_6 = Line(StartPoint=list_item_2.Item1, EndPoint=list_item_3.Item1)
line_7 = Line(StartPoint=list_item_2.Item, EndPoint=end_points.End)
line_8 = Line(StartPoint=list_item_3.Item, EndPoint=list_item_2.Item)
line_9 = Line(StartPoint=list_item_3.Item, EndPoint=end_points.End)
join_curves = JoinCurves(Curves=[line_5, line_6, line_4], Preserve=False)
join_curves_2 = JoinCurves(Curves=[line_2, line, line_3], Preserve=False)
join_curves_3 = JoinCurves(Curves=[line_8, line_9, line_7], Preserve=False)
fillet = Fillet(Curve=[join_curves_3, join_curves, join_curves_2], Radius=Slider(0.24, range=0..1))
list_item_4 = ListItem(List=fillet, Index=0, Wrap=True)  # -> Item, Item1, Item2
curve = Curve(list_item.Item2)
curve_2 = Curve(list_item.Item1)
curve_3 = Curve(list_item.Item)
rotate_axis = RotateAxis(Geometry=list_item_4.Item, Angle=degrees(size_of_opening), Axis=curve)  # -> Geometry, Transform
rotate_axis_2 = RotateAxis(Geometry=list_item_4.Item2, Angle=degrees(size_of_opening), Axis=curve_3)  # -> Geometry, Transform
rotate_axis_3 = RotateAxis(Geometry=list_item_4.Item1, Angle=degrees(size_of_opening), Axis=curve_2)  # -> Geometry, Transform
boundary_surfaces = BoundarySurfaces(Edges=rotate_axis_3.Geometry)
boundary_surfaces_2 = BoundarySurfaces(Edges=rotate_axis_2.Geometry)
boundary_surfaces_3 = BoundarySurfaces(Edges=rotate_axis.Geometry)
brep_join = BrepJoin(Breps=[boundary_surfaces_3, boundary_surfaces, boundary_surfaces_2])  # -> Breps, Closed
brep = Brep(flatten(brep_join.Breps))
context_bake = ContextBake(Content=brep)
