# Grasshopper definition Pyramids_cells_Hops.gh (Grasshopper 1.0.8)
# plug-ins: Hops

hops = Hops(
    SizeOfTriangle=Slider(15, range=0..100),
    NumberOfCellsX=Slider(4, range=0..10),
    NumberOfCellsY=Slider(5, range=0..10),
    SizeOfOpening=Slider(21, range=0..100),
    CacheResultsInMemory=True,
    CacheSolveResults=True,
    RemoteDefinitionLocation="C:\Users\dxhad0\Desktop\Session01\Pyramids_cells.gh",
    RemoteSolveVersion=(0, 1, 0),
    ShowInput_Enabled=False,
    ShowInput_Path=False,
    SynchronousSolve=True)
