# Grasshopper definition Solar Radiation -Paneling-Simulation.gh (Grasshopper 1.0.8)
# plug-ins: MeshEdit Components

months = Slider(3, range=0..11)
hours = Slider(8, range=0..23)
days = Slider(13, range=0..29)
day = GetInteger(days, AtLeast=1, AtMost=1, Maximum=2147483647, Minimum=-2147483648, TreeAccess=False)
month = GetInteger(months, AtLeast=1, AtMost=1, Maximum=2147483647, Minimum=-2147483648, TreeAccess=False)
hour = GetInteger(hours, AtLeast=1, AtMost=1, Maximum=2147483647, Minimum=-2147483648, TreeAccess=False)
series = Series(Start=0, Step=1, Count=day)
series_2 = Series(Start=0, Step=1, Count=month)
series_3 = Series(Start=0, Step=1, Count=hour)
hoy = LBCalculateHOY(month=series_2, day=series, hour=series_3)  # -> flatten(hoy), flatten(doy), flatten(date); plug-in component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

# ---- group: WEATHER DATA
panel = Panel("https://climate.onebuilding.org/WMO_Region_2_Asia/JPN_Japan/TK_Tokyo/JPN_TK_Tokyo.Heli.476870_TMYx.zip")
epwmap = LBEPWmap(epw_map=Button())  # -> Output; plug-in component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
downloadepw = LBDownloadWeather(weather_URL=panel)  # -> epw_file, stat_file, ddy_file; plug-in component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
importepw = LBImportEPW(epw_file="C:\Users\dxhad0\AppData\Roaming\ladybug_tools\weather\JPN_TK_Tokyo.Heli.476870_TMYx\JPN_TK_Tokyo.Heli.476870_TMYx.epw")  # -> location, dry_bulb_temperature, dew_point_temperature, relative_humidity, wind_speed, wind_direction, direct_normal_rad, diffuse_horizontal_rad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; plug-in component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
skymatrix = LBCumulativeSkyMatrix(
    location=importepw.location,
    direct_rad=importepw.direct_normal_rad,
    diffuse_rad=importepw.diffuse_horizontal_rad,
    hoys=hoy.hoy,
    folder="C:\Users\dxhad0\Downloads\Direc")  # -> out, sky_mtx; plug-in component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

# ---- group: GEOMETRY
geometry = Geometry([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])
geometry_2 = Geometry([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])
facade_nw = Surface([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])
brep = Brep(facade_nw)
data = Data([geometry, geometry_2])
data_2 = Data(brep)

# ---- group: SIMULATION
legendpar = LBLegendParameters(min="0", max="500", num_decimals="0", seg_height=Slider(10, range=0..10))  # -> leg_par; plug-in component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
incidentradiation = LBIncidentRadiation(
    sky_mtx=skymatrix.sky_mtx,
    geometry=flatten(data_2),
    context=flatten(data),
    grid_size="10",
    offset_dist=".1",
    legend_par=legendpar,
    run=Toggle(True))  # -> out, points, results, total, mesh, legend, title, int_mtx; plug-in component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

# ---- group: Paneling
mesh = Mesh(incidentradiation.mesh)
mesh_explode = MeshExplode(Mesh=mesh, Interpolate=False)
number_slider = Slider(0.01, range=0..0.01)
bounds = Bounds(Numbers=incidentradiation.results)
point = Point(incidentradiation.points)
construct_domain = ConstructDomain(DomainStart=Slider(0.1, range=0..0.1), DomainEnd=Slider(0.948, range=0..1))
remap_numbers = RemapNumbers(Value=incidentradiation.results, Source=bounds, Target=construct_domain)  # -> Mapped, Clipped
scale = Scale(Geometry=mesh_explode, Center=point, Factor=remap_numbers.Mapped)  # -> Geometry, Transform
mesh_2 = Mesh(scale.Geometry)
panel_2 = Panel(remap_numbers.Mapped)
weld = WeldMesh(Mesh=mesh_2, Angle=3.141592654)
context_bake = ContextBake(Geometry=weld)
